# Dynamo graph BarCharts.dyn (Dynamo 2.2.0.3994)

code_block = CodeBlock { ["Basic Sample"]; [[1, 2, 3, 4]]; []; }
bar = BarChartNodeModel(labels=code_block.out0, values=code_block.out1, colors=code_block.out2, Labels=["Basic Sample"], Values=[[1, 2, 3, 4]], Colors=["#FFE2166D"])
code_block_2 = CodeBlock()
# ---------- code_block_2.designscript (7 lines) ----------
["Item 1", "Item 2", "Item 3"];
[[1, 2], [3, 4], [5, 6]];
[
	Color.ByARGB(255, 255, 0, 0),
	Color.ByARGB(255, 0, 255, 0),
	Color.ByARGB(255, 0, 0, 255)
];
# ----------------------------------------
bar_2 = BarChartNodeModel(labels=code_block_2.out0, values=code_block_2.out1, colors=code_block_2.out2, Labels=["Item 1", "Item 2", "Item 3"], Values=[[1, 2], [3, 4], [5, 6]], Colors=["#FFFF0000", "#FF00FF00", "#FF0000FF"])
bar_3 = BarChartNodeModel()  # unwired: labels, values, colors
