# Dynamo graph BasicLineCharts.dyn (Dynamo 2.2.0.3945)

code_block = CodeBlock { [Color.ByARGB(0,0,0,0)]; }
basic_line = BasicLineChartNodeModel()  # unwired: titles, values, labels, colors
number_slider = DoubleSlider(52.9, range=0..100 step 0.1)
code_block_2 = CodeBlock(x=number_slider)
# ---------- code_block_2.designscript (6 lines) ----------
["Line1", "Line2", "Line3"];
[
	[1, 10, 5],
	[2, x, 10],
	[3, 25, 15]
];
# ----------------------------------------
color_palette = ColorPalette({R: 220, G: 20, B: 60, A: 255})
color_palette_2 = ColorPalette({R: 0, G: 255, B: 0, A: 255})
color_palette_3 = ColorPalette({R: 0, G: 0, B: 255, A: 255})
list_create = List.Create(item0=color_palette, item1=color_palette_2, item2=color_palette_3)
basic_line_2 = BasicLineChartNodeModel(labels=code_block_2.out0, values=code_block_2.out1, colors=list_create, Labels=["Line1", "Line2", "Line3"], Values=[[1, 10, 5], [2, 52.9, 10], [3, 25, 15]], Colors=["#FFDC143C", "#FF00FF00", "#FF0000FF"])
number_slider_2 = DoubleSlider(100, range=0..100 step 1)
randomList = Math.RandomList(amount=number_slider_2)
code_block_3 = CodeBlock(values=randomList) { ["Line1"]; [values]; }
color_palette_4 = ColorPalette({R: 138, G: 43, B: 226, A: 255})
list_create_2 = List.Create(item0=color_palette_4)
basic_line_3 = BasicLineChartNodeModel(labels=code_block_3.out0, values=code_block_3.out1, colors=list_create_2, Labels=["Line1"], Values=[[0.5970123027, 0.130979199, 0.3862732972, 0.1346767657, 0.002196843737, 0.6723493043, 0.6129036414, 0.1596843503, 0.127741261, 0.2655147935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]], Colors=["#FF8A2BE2"])
