# Dynamo graph HeatSeriesCharts.dyn (Dynamo 2.2.0.3994)

heat_series_plot = HeatSeriesNodeModel()  # unwired: x_labels, y_labels, values, colors
code_block = CodeBlock { 0..9..1; }
string_from_object = FromObject(obj=code_block)
count = List.Count(list=code_block)
code_block_2 = CodeBlock(c=count)
# ---------- code_block_2.designscript (14 lines) ----------
[
	Math.RandomList(c),
	Math.RandomList(c),
	Math.RandomList(c),
	Math.RandomList(c),
	Math.RandomList(c),
	Math.RandomList(c),
	Math.RandomList(c),
	Math.RandomList(c),
	Math.RandomList(c),
	Math.RandomList(c)
];

[];
# ----------------------------------------
heat_series_plot_2 = HeatSeriesNodeModel(x_labels=string_from_object, y_labels=string_from_object, values=code_block_2.out0, colors=code_block_2.out1, XLabels=["0", "1", "2", "3", "4", "5", "6", "7", "8", "9"], YLabels=["0", "1", "2", "3", "4", "5", "6", "7", "8", "9"], Colors=["#FF67FE63"])
code_block_3 = CodeBlock()
# ---------- code_block_3.designscript (30 lines) ----------
// X-Labels
[
	"User-1",
	"User-2",
	"User-3",
	"User-4",
	"User-5"
];

// Y-Labels
[
	"Option-1",
	"Option-2",
	"Option-3"
];

// Values
[
	[0, 1, 2],
	[3, 4, 5],
	[6, 7, 8],
	[9, 10, 11],
	[12, 13, 14]
];

// Colors
[
	Color.ByARGB(255, 255, 0, 0),
	Color.ByARGB(255, 0, 0, 255)
];
# ----------------------------------------
heat_series_plot_3 = HeatSeriesNodeModel(x_labels=code_block_3.out0, y_labels=code_block_3.out1, values=code_block_3.out2, colors=code_block_3.out3, XLabels=["User-1", "User-2", "User-3", "User-4", "User-5"], YLabels=["Option-1", "Option-2", "Option-3"], Values=[[0, 1, 2], [3, 4, 5], [6, 7, 8], [9, 10, 11], [12, 13, 14]], Colors=["#FFFF0000", "#FF0000FF"])
