# Dynamo graph PieCharts.dyn (Dynamo 2.2.0.3945)

number_slider = DoubleSlider(45, range=0..100 step 0.1)
code_block = CodeBlock(x=number_slider) { ["Person1", "Person2", "Person3"]; [x, 50.5, 100.4]; }
color_palette = ColorPalette({R: 220, G: 20, B: 60, A: 255})
color_palette_2 = ColorPalette({R: 0, G: 255, B: 0, A: 255})
color_palette_3 = ColorPalette({R: 0, G: 0, B: 255, A: 255})
list_create = List.Create(item0=color_palette, item1=color_palette_2, item2=color_palette_3)
pie = PieChartNodeModel(labels=code_block.out0, values=code_block.out1, color=list_create, Labels=["Person1", "Person2", "Person3"], Values=[45, 50.5, 100.4], Colors=["#FFDC143C", "#FF00FF00", "#FF0000FF"])
code_block_2 = CodeBlock(x=number_slider)
# ---------- code_block_2.designscript (11 lines) ----------
chartData =
{
	"alfarok" : x,
	"Person2" : 150,
	"Person3" : 150,
	"Person4" : 150
};

chartData.Keys;
chartData.Values;
[];
# ----------------------------------------
pie_2 = PieChartNodeModel(labels=code_block_2.out1, values=code_block_2.out2, color=code_block_2.out3, Labels=["alfarok", "Person2", "Person3", "Person4"], Values=[45, 150, 150, 150], Colors=["#FFB2470C", "#FF0AE3C6", "#FF01EF55", "#FFAA0DA8"])
pie_3 = PieChartNodeModel()  # unwired: labels, values, color
color_palette_4 = ColorPalette({R: 220, G: 20, B: 60, A: 255})
color_palette_5 = ColorPalette({R: 0, G: 255, B: 0, A: 255})
color_palette_6 = ColorPalette({R: 0, G: 0, B: 255, A: 255})
list_create_2 = List.Create(item0=color_palette_4, item1=color_palette_5, item2=color_palette_6)
number_slider_2 = DoubleSlider(97.7, range=0..100 step 0.1)
code_block_3 = CodeBlock(x=number_slider_2)
# ---------- code_block_3.designscript (7 lines) ----------
["Line1", "Line2", "Line3"];
[
	[2, 4, 6],
	[1, x, 5],
	[0, 5, 10]
];
["A", "B", "C"];
# ----------------------------------------
color_palette_7 = ColorPalette({R: 138, G: 43, B: 226, A: 255})
list_create_3 = List.Create(item0=color_palette_7)
number_slider_3 = DoubleSlider(100, range=0..100 step 1)
randomList = Math.RandomList(amount=number_slider_3)
code_block_4 = CodeBlock(values=randomList) { ["Line1"]; [values]; ["Start", "Mid", "End"]; }
code_block_5 = CodeBlock { [Color.ByARGB(0,0,0,0)]; }
integer_slider = IntegerSlider(2, range=1..10 step 1)
code_block_6 = CodeBlock(x=integer_slider) { x * Math.PI; }
code_block_7 = CodeBlock(x=code_block_6) { -x; }
code_block_8 = CodeBlock { Math.PI/2; }
range = Range(start=code_block_7, end=code_block_6, step=code_block_8)
radiansToDegrees = Math.RadiansToDegrees(radians=range)
sin = Math.Sin(angle=radiansToDegrees)
cos = Math.Cos(angle=radiansToDegrees)
tan = Math.Tan(angle=radiansToDegrees)
