# Dynamo graph ScatterPlots.dyn (Dynamo 2.2.0.3945)

integer_slider = IntegerSlider(81, range=1..100 step 1)
randomList = Math.RandomList(amount=integer_slider)
randomList_2 = Math.RandomList(amount=integer_slider)
randomList_3 = Math.RandomList(amount=integer_slider)
randomList_4 = Math.RandomList(amount=integer_slider)
randomList_5 = Math.RandomList(amount=integer_slider)
randomList_6 = Math.RandomList(amount=integer_slider)
code_block = CodeBlock(x1=randomList, x2=randomList_2, x3=randomList_3, y1=randomList_4, y2=randomList_5, y3=randomList_6)
# ---------- code_block.designscript (6 lines) ----------
["Set-1", "Set-2", "Set-3"];
[x1, x2, x3];
[y1, y2, y3];
[Color.ByARGB(255,255,0,0),
Color.ByARGB(255,0,255,0),
Color.ByARGB(255,0,0,255)];
# ----------------------------------------
scatter_plot = ScatterPlotNodeModel(labels=code_block.out0, x_values=code_block.out1, y_values=code_block.out2, colors=code_block.out3, Labels=["Set-1", "Set-2", "Set-3"], Colors=["#FFFF0000", "#FF00FF00", "#FF0000FF"])
