# Dynamo graph XYLineCharts.dyn (Dynamo 2.2.0.3945)

integer_slider = IntegerSlider(-10, range=-10..10 step 1)
color_palette = ColorPalette({R: 255, G: 127, B: 80, A: 255})
code_block = CodeBlock(slide=integer_slider, color=color_palette) { ["MyLine"]; [[0, 1, 2]]; [[0, slide, 2]]; [color]; }
xy_line = XYLineChartNodeModel(labels=code_block.out0, x_values=code_block.out1, y_values=code_block.out2, colors=code_block.out3, Labels=["MyLine"], XValues=[[0, 1, 2]], YValues=[[0, -10, 2]], Colors=["#FFFF7F50"])
piTimes2 = Math.PiTimes2()
code_block_2 = CodeBlock(x=piTimes2) { -x; }
PI = Math.PI()
code_block_3 = CodeBlock(x=PI) { x/4; }
range = Range(start=code_block_2, end=piTimes2, step=code_block_3)
radiansToDegrees = Math.RadiansToDegrees(radians=range)
sin = Math.Sin(angle=radiansToDegrees)
color_palette_2 = ColorPalette({R: 138, G: 43, B: 226, A: 255})
code_block_4 = CodeBlock(x=range, y=sin, color=color_palette_2) { ["Sine Curve"]; [x]; [y]; [color]; }
xy_line_2 = XYLineChartNodeModel(labels=code_block_4.out0, x_values=code_block_4.out1, y_values=code_block_4.out2, colors=code_block_4.out3, Labels=["Sine Curve"], XValues=[[-6.283185307, -5.497787144, -4.71238898, -3.926990817, -3.141592654, -2.35619449, -1.570796327, -0.7853981634, -6e-15, 0.7853981634, 1.570796327, 2.35619449, 3.141592654, 3.926990817, 4.71238898, 5.497787144, 6.283185307]], YValues=[[-4.195970828e-15, 0.7071067812, 1, 0.7071067812, 4.762520673e-15, -0.7071067812, -1, -0.7071067812, -6e-15, 0.7071067812, 1, 0.7071067812, 6.783798783e-15, -0.7071067812, -1, -0.7071067812, -8.238527048e-15]], Colors=["#FF8A2BE2"])
